# Dynamo graph Echo_In.dyn (Dynamo 2.0.1.5055)

string = StringInput("Plane")
python_script = Python(IN[0]=string)
# ---------- python_script.python (16 lines) ----------
# Activer la prise en charge de Python et charger la bibliothèque DesignScript
import clr
clr.AddReference('ProtoGeometry')
from System.IO import File
from Autodesk.DesignScript.Geometry import *

# Les entrées effectuées dans ce noeud sont stockées sous forme de liste dans les variables IN.
dataEnteringNode = IN

# Placer votre code au-dessous de cette ligne

# Affectez la sortie à la variable OUT.
#OUT = "C:/Temp/" + "ec_vertex_" +  IN[0] + ".txt"
#OUT = IN[1] + File.separator + "ec_vertex_" +  IN[0] + ".txt"
name = IN[0]
OUT = "C:/Temp/" + "rex_vertex_" + name + ".txt"
# ----------------------------------------
file_from_path = FileObject(path=python_script)
readText = FileSystem.ReadText(file=file_from_path)
