# Dynamo graph Echo_Out.dyn (Dynamo 2.0.1.5055)

levels = Levels(index=0)  # graph input
all_elements_at_level = ElementsAtLevel(Level=levels)
# note: Add walls on level 0
categories = Categories(index=327)  # graph input
all_elements_of_category = ElementsOfCategory(Category=categories)
# note: All walls
watch = Watch(all_elements_of_category)
all_elements_of_type = ElementsOfType()  # unwired: element_type
element_types = ElementTypes(index=332)  # graph input
all_elements_of_type_2 = ElementsOfType(element_type=element_types)
# note: walls by level
watch_2 = Watch(all_elements_of_type_2)
# note: Width/height
code_block = CodeBlock { ["Height","Width"]; }
getParameterValueByName = Element.GetParameterValueByName(element=watch_2, parameterName=code_block)
watch_3 = Watch(getParameterValueByName)
parameters = Element.Parameters(element=watch_2)
# note: Parameters
watch_4 = Watch(parameters)
geometry = Element.Geometry(element=watch_2)
# note: Geometry
watch_5 = Watch(geometry)
# note: Explode
explode = Geometry.Explode(geometry=watch_5)
firstItem = List.FirstItem(list=explode)
watch_6 = Watch(firstItem)
vertices = Face.Vertices()  # unwired: face
watch_7 = Watch(explode)
code_block_2 = CodeBlock { 1; }
# note: Flatten
flatten = List.Flatten(list=watch_7, amt=code_block_2)
vertices_2 = Topology.Vertices(topology=flatten)
watch_8 = Watch(vertices_2)
flatten_2 = List.Flatten(list=vertices_2, amt=code_block_2)
watch_9 = Watch(flatten_2)
python_script = Python(IN[0]=flatten_2)
# ---------- python_script.python (41 lines) ----------
import time
import clr
clr.AddReference('ProtoGeometry')
from Autodesk.DesignScript.Geometry import *

# Input

name = "obj"
path = "C:\\temp\\"
vertex_path = path + "ec_vertex_" + name + ".txt"
face_path = path + "ec_faces_" + name + ".txt"
version_path = path + "ec_version_" + name + ".txt"


data = IN

faces = IN[0]

vertex_file = open(vertex_path,"w")
face_file = open(face_path,"w")
version_file = open(version_path,"w")

i = 0
for f in faces:
	face_file.write(str(i+0) + "," + str(i+1) + "," + str(i+2) + "," + str(i+3) + "\n")
	i+= 4
	for p in f:
			v = p.PointGeometry 
			vertex_file.write(str(v.X) + "," + str(v.Y) + "," + str(v.Z) + "\n")

version_file.write(str(int(time.time())) + "\n")

face_file.close()
vertex_file.close()
version_file.close()


# Output 

OUT = IN
OUT = "..."
# ----------------------------------------
watch_10 = Watch(python_script)
